# Grasshopper definition 201204SmockingSim_Simplified.gh (Grasshopper 1.0.7)
# plug-ins: MeshEdit Components, NGon 2, Human, Kangaroo Components, Bifocals, LunchBox, Weaverbird, Kangaroo2 Components

# PlugIns Used: NGon 2
# Kangaroo Components 0.099
# Kangaroo2 Components 2.5.2
# Human 1.1.0
# Bifocals
# MeshEdit Components 1.0.9.0
# Weaverbird 0.9.0.1
# LunchBox 2016.3.21.0
# All Components Used: DATE- 2020.12.04 TIME- 15:20h
# Last saved by - annie
# Total Components - 277
# Human:
# ...Display:
# ......Custom Preview Lineweights - 1
# LunchBox:
# ...Workflow:
# ......Object Bake - 3
# Vector:
# ...Point:
# ......Closest Point - 10
# ......Deconstruct - 1
# ......Construct Point - 1
# Params:
# ...Geometry:
# ......Plane - 1
# ......Mesh - 12
# ......Curve - 24
# ......Point - 20
# ......Surface - 2
# ...Util:
# ......Sketch - 7
# ......Data Dam - 3
# ......O_GetCompsCluster - 1
# ......Bifocals - 1
# ......Scribble - 8
# ...Primitive:
# ......Data - 7
# ...Input:
# ......Panel - 14
# ......Button - 3
# ......Colour Swatch - 4
# ......Boolean Toggle - 1
# ......Number Slider - 25
# NGon:
# ...Util:
# ......Text - 1
# Mesh:
# ...Triangulation:
# ......Delaunay Mesh - 1
# ...Analysis:
# ......Mesh Area - 2
# ......Mesh Closest Point - 4
# ......Mesh Explode - 1
# ......Mesh Eval - 3
# ......Deconstruct Mesh - 2
# ......Mesh Edges - 1
# Kangaroo:
# ...Mesh:
# ......Combine&Clean - 1
# ...Utility:
# ......removeDuplicatePts - 3
# ......removeDuplicateLines - 2
# Display:
# ...Preview:
# ......Custom Preview - 3
# ...Vector:
# ......Point List - 2
# Curve:
# ...Spline:
# ......PolyLine - 1
# ...Analysis:
# ......Discontinuity - 5
# ......Length - 1
# ......End Points - 4
# ......Point On Curve - 3
# ......Curve Closest Point - 2
# ......Point In Curve - 2
# ......Closed - 1
# ...Primitive:
# ......Line - 2
# ...Util:
# ......Join Curves - 1
# ......Explode - 5
# ...Division:
# ......Divide Curve - 1
# ......Shatter - 1
# Transform:
# ...Euclidean:
# ......Orient - 1
# Maths:
# ...Util:
# ......Average - 1
# ...Operators:
# ......Equality - 1
# ......Division - 1
# ......Smaller Than - 3
# Kangaroo2:
# ...Goals-Lin:
# ......Length(Line) - 2
# ...Goals-Col:
# ......SphereCollide - 1
# ...Mesh:
# ......Refine - 1
# ......Combine&Clean - 3
# ...Goals-Pt:
# ......Anchor - 1
# ...Main:
# ......Solver - 1
# ......Show - 2
# ...Goals-On:
# ......OnPlane - 1
# ......OnCurve - 1
# ...Utility:
# ......removeDuplicatePts - 2
# ...Goals-Mesh:
# ......Pressure - 1
# Wb:
# ...SubD:
# ......Weaverbird's Catmull-Clark Subdivision - 1
# ......Weaverbird's Split Triangles Subdivision - 1
# ......Weaverbird's Split Polygons Subdivision - 1
# ...Extract:
# ......Weaverbird's Naked boundary - 2
# ......Weaverbird's Mesh Edges - 3
# OTools:
# ...3 | Debugging:
# ......OTools_GetComponents2 - 1
# Surface:
# ...Primitive:
# ......Bounding Box - 1
# ...Analysis:
# ......Evaluate Surface - 1
# ......Area - 5
# ......Deconstruct Brep - 1
# ......Surface Closest Point - 1
# Sets:
# ...List:
# ......Dispatch - 6
# ......List Item - 4
# ...Text:
# ......Concatenate - 13
# ...Tree:
# ......Merge - 1
# ......Explode Tree - 1
# ......Flatten Tree - 2
# ......Graft Tree - 4
# ......Entwine - 1
button = Button()

# ---- group: hyperbola - 374mmx352mm, kjsfakljdsl; / 2d starting mesh vertices
pt = Point(flatten([Point(826.2373657, -46.49938965, 0), Point(955.5571899, -264.0089722, 0), Point(831.8563843, -484.7625427, 0), Point(702.5648193, -267.2410889, 0), Point(573.208374, -49.73662186, 0), Point(449.5040894, -270.4936218, 0)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]))

# ---- group: hyperbola - 374mmx352mm, kjsfakljdsl; / closed smocks post-simulation
crv = Curve([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])

# ---- group: hyperbola - 374mmx352mm, kjsfakljdsl; / ron resch triangles
crv_2 = Curve(Tree({0}: [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], {1}: [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], {2}: [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], {3}: [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], {4}: [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], {5}: [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]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))

# ---- group: hyperbola - 374mmx352mm, kjsfakljdsl; / fabric boundary
crv_3 = Curve(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)

# ---- group: hyperbola - 374mmx352mm, kjsfakljdsl; / input mesh
mesh = Mesh(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)

# ---- group: hyperbola - 374mmx352mm, kjsfakljdsl; / 2d mesh
mesh_2 = Mesh(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)

# ---- group: hyperbola - 374mmx352mm, kjsfakljdsl; / 2d smocks pre-simulation
crv_4 = Curve(Tree({0;0}: [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], {1;0}: [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], {2;0}: [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], {3;0}: [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], {4;0}: [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], {5;0}: [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]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))

# ---- group: hyperbola - 374mmx352mm, kjsfakljdsl; / smocks
crv_5 = Curve([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])

# ----
# University of Malaga Kangaroo Workshop Dec 3-4
# Day 02
# -------------------------------------------------------------------
# Concrete Form[ing]work Script
# Annie Locke Scherer
# STEP 01: Turn off everything
# STEP 02: work each divided section at a time.
# Red = requiring the user
# Cyan = preview
# Once each section is done you can turn off that preview and move to the next section.
o_getcompscluster = O_GetCompsCluster()
o_getcomps2 = OTools_GetComponents2(x=button)  # inputs x: Boolean; plug-in component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

# ---- group: simple hyperbola / ron resch triangles
crv_6 = Curve(crv_2)

# ---- group: simple hyperbola / 2d mesh
mesh_3 = Mesh(mesh_2)

# ---- group: simple hyperbola / 2d starting mesh vertices
# Input internalized components
# from smock generation script
pt_2 = Point(flatten(pt))

# ---- group: simple hyperbola / closed smocks post-simulation
crv_7 = Curve(crv)

# ---- group: simple hyperbola / 2d smocks pre-simulation
crv_8 = Curve(crv_4)

# ---- group: simple hyperbola / fabric boundary
crv_9 = Curve(crv_3)

# ---- group: simple hyperbola / input mesh
mesh_4 = Mesh(mesh)

# ---- group: simple hyperbola / smocks
crv_10 = Curve(crv_5)

# ---- group: 2d starting mesh vertices
# construct fabric mesh from smocking lines
pt_3 = Point(flatten(pt_2))

# ---- group: closed smocks post-simulation
crv_11 = Curve(crv_7)

# ---- group: 2d smocks pre-simulation
crv_12 = Curve(crv_8)

# ---- group: ron resch triangles
crv_13 = Curve(crv_6)

# ---- group: 2d mesh
mesh_5 = Mesh(mesh_3)

# ---- group: smocks
crv_14 = Curve(crv_10)

# ---- group: fabric boundary
crv_15 = Curve(crv_9)

# ---- group: input mesh
mesh_6 = Mesh(mesh_4)

# ----
explode = Explode(Curve=crv_15, Recursive=True)  # -> Segments, Vertices

# ---- group: construct mesh fabric to smock for sim
end = EndPoints(Curve=explode.Segments)  # -> Start, End
disc = Discontinuity(Curve=crv_13, Level=1)  # -> Points, Parameters
pt_4 = Point(flatten([end.Start, end.End, disc.Points]))
duppt = RemoveDuplicatePts(Points=pt_4, Tolerance=Slider(5, range=0..10))
del = DelaunayMesh(Points=duppt, Plane=PlaneXY(0, 0, 0))
explode_2 = MeshExplode(Mesh=del, Interpolate=False)
area = MeshArea(Mesh=explode_2)  # -> Area, Centroid
incurve = PointInCurve(Point=area.Centroid, Curve=crv_15)  # -> Relationship, Point
dispatch = Dispatch(List=explode_2, DispatchPattern=incurve.Relationship)  # -> ListA, ListB
mesh_7 = Mesh(dispatch.ListA)
clean = CombineClean(Meshes=mesh_7)
wbsplitpolygons = WeaverbirdsSplitPolygonsSubdivision(MeshCurves=clean, Level=1, SmoothNakedEdges=2)
wbtriangles = WeaverbirdsSplitTrianglesSubdivision(MeshCurves=wbsplitpolygons, Level=Slider(2, range=0..10))

# ----
mesh_8 = Mesh(wbtriangles)
dam = DataDam(DataA=wbtriangles, BufferDelay=10000000, BufferMode=0)

# ---- group: alternate refining of mesh. only do if your computer can handle it (crash warning)
# refine mesh
# (only if computer can handle it)
refine = Refine(Mesh=dam, Level=Slider(1, range=0..10))
# check target mesh - correct orientation
clean_2 = CombineClean(Meshes=refine)

# ---- group: higher res mesh
mesh_9 = Mesh(clean_2)

# ----
dam_2 = DataDam(DataA=mesh_9, BufferDelay=10000000, BufferMode=0)

# ---- group: orient 3d mesh for targeting / input mesh
mesh_10 = Mesh(mesh_6)

# ---- group: orient 3d mesh for targeting / 2d mesh
mesh_11 = Mesh(mesh_5)

# ---- group: select top/"front" face
number_slider = Slider(5, range=0..10)

# ---- group: fabric to smock
clean_3 = CombineClean(Meshes=flatten(dam_2))

# ---- group: 2d starting mesh vertices
pt_5 = Point(flatten(pt_3))

# ---- group: closed smocks post-simulation
crv_16 = Curve(crv_11)

# ---- group: 2d smocks pre-simulation
crv_17 = Curve(crv_12)

# ----
demesh = DeconstructMesh(Mesh=clean_3)  # -> Vertices, Faces, Colours, Normals

# ---- group: keep smock points on 3d mesh (generally) / sort smocks into lozenge or arrow
explode_3 = Explode(Curve=crv_16, Recursive=True)  # -> flatten(Segments), Vertices
dupln = RemoveDuplicateLines(Lines=explode_3.Segments, Tolerance=Slider(5, range=0..10))
join = JoinCurves(Curves=dupln, Preserve=False)
cls = Closed(Curve=join)  # -> Closed, Periodic
dispatch_2 = Dispatch(List=join, DispatchPattern=cls.Closed)  # -> flatten(ListA), flatten(ListB)

# ---- group: smocks
explode_4 = Explode(Curve=crv_14, Recursive=True)  # -> flatten(Segments), Vertices
dupln_2 = RemoveDuplicateLines(Lines=explode_4.Segments, Tolerance=0.01)
end_2 = EndPoints(Curve=dupln_2)  # -> Start, End
meshcp = MeshClosestPoint(Point=end_2.End, Mesh=clean_3)  # -> Point, Index, Parameter
meshcp_2 = MeshClosestPoint(Point=end_2.Start, Mesh=clean_3)  # -> Point, Index, Parameter
meval = MeshEval(Mesh=clean_3, Parameter=meshcp_2.Parameter)  # -> Point, Normal, Colour
meval_2 = MeshEval(Mesh=clean_3, Parameter=meshcp.Parameter)  # -> Point, Normal, Colour
cp = ClosestPoint(Point=meval.Point, Cloud=demesh.Vertices)  # -> ClosestPoint, CPIndex, Distance
cp_2 = ClosestPoint(Point=meval_2.Point, Cloud=demesh.Vertices)  # -> ClosestPoint, CPIndex, Distance
graft = GraftTree(Tree=flatten(cp_2.ClosestPoint), IncludeEmptyLists=True, IncludeNullItems=True)
graft_2 = GraftTree(Tree=flatten(cp.ClosestPoint), IncludeEmptyLists=True, IncludeNullItems=True)
ln = Line(StartPoint=graft_2, EndPoint=graft)  # -> flatten(Line)

# ---- group: keep mesh edges on boundary / smocks
crv_18 = Curve(ln)

# ---- group: keep mesh edges on boundary / shatter boundary curve based on smock pts
wbnaked = WeaverbirdsNakedBoundary(MeshClosedPolylines=clean_3)
disc_2 = Discontinuity(Curve=crv_18, Level=1)  # -> flatten(Points), Parameters
incurve_2 = PointInCurve(Point=disc_2.Points, Curve=wbnaked)  # -> Relationship, Point
equals = Equality(FirstNumber=incurve_2.Relationship, SecondNumber=Slider(1, range=0..1))  # -> Equality, Inequality
dispatch_3 = Dispatch(List=disc_2.Points, DispatchPattern=equals.Equality)  # -> ListA, ListB
pt_6 = Point(dispatch_3.ListA)

# ---- group: keep mesh edges on boundary / dispatch curves on boundary with smocks on them
crv_cp = CurveClosestPoint(Point=pt_6, Curve=wbnaked)  # -> Point, Parameter, Distance
shatter = Shatter(Curve=wbnaked, Parameters=crv_cp.Parameter)
curvepoint = PointOnCurve(crv_18, parameter=0.5)
curvepoint_2 = PointOnCurve(shatter, parameter=0.5)
cp_3 = ClosestPoint(Point=curvepoint_2, Cloud=curvepoint)  # -> ClosestPoint, CPIndex, Distance
smaller = SmallerThan(FirstNumber=cp_3.Distance, SecondNumber=Slider(3, range=0..10))  # -> SmallerThan, OrEqualTo
dispatch_4 = Dispatch(List=shatter, DispatchPattern=smaller.SmallerThan)  # -> ListA, ListB
crv_19 = Curve(dispatch_4.ListB)

# ---- group: keep smock points on 3d mesh (generally) / losenge smocks
crv_20 = Curve(simplify(dispatch_2.ListB))

# ---- group: keep smock points on 3d mesh (generally) / arrow smocks
crv_21 = Curve(simplify(dispatch_2.ListA))

# ---- group: double check correct target pts / ordered smocks ready to go to targets
# kangaroo simulation!
flatten = FlattenTree(Tree=crv_16, Path="{0}")
explode_5 = Explode(Curve=flatten, Recursive=True)  # -> Segments, Vertices
end_3 = EndPoints(Curve=explode_5.Segments)  # -> Start, End
cp_4 = ClosestPoint(Point=[end_3.Start, end_3.End], Cloud=demesh.Vertices)  # -> simplify(ClosestPoint), CPIndex, Distance
duppt_2 = RemoveDuplicatePts(Points=cp_4.ClosestPoint, Tolerance=0.01)  # -> simplify(UniquePoints)

# ---- group: anchor smocks to target mesh vertice / ordered smocks ready to go to targets
flatten_2 = FlattenTree(Tree=crv_16, Path="{0}")
explode_6 = Explode(Curve=flatten_2, Recursive=True)  # -> Segments, Vertices
end_4 = EndPoints(Curve=explode_6.Segments)  # -> Start, End
pt_7 = Point([end_4.Start, end_4.End])
cp_5 = ClosestPoint(Point=pt_7, Cloud=demesh.Vertices)  # -> simplify(ClosestPoint), CPIndex, Distance
duppt_3 = RemoveDuplicatePts(Points=cp_5.ClosestPoint, Tolerance=0.01)  # -> simplify(UniquePoints)

# ---- group: keep smock points on 3d mesh (generally)
curvepoint_3 = PointOnCurve(crv_20, parameter=0.5)
disc_3 = Discontinuity(Curve=[crv_20, crv_21], Level=1)  # -> Points, Parameters
area_2 = Area(Geometry=crv_21)  # -> Area, Centroid

# ---- group: keep mesh edges on boundary / fabric boundary
crv_22 = Curve(crv_15)

# ---- group: keep smock points on 3d mesh (generally) / CLEANED SMOCK AREA + MIDPOINTS
pt_8 = Point(flatten([area_2.Centroid, curvepoint_3]))

# ---- group: keep smock points on 3d mesh (generally) / ALL SMOCKS CLEANED
crv_23 = Curve([crv_21, crv_20])

# ---- group: keep smock points on 3d mesh (generally) / CLEANED SMOCK DISCONTINUITIES
pt_9 = Point(flatten(disc_3.Points))

# ---- group: keep mesh edges on boundary / naked edges not on smock
divide = DivideCurve(Curve=crv_19, Count=Slider(20, range=0..100), Kinks=False)  # -> flatten(Points), Tangents, Parameters
meshcp_3 = MeshClosestPoint(Point=divide.Points, Mesh=clean_3)  # -> Point, Index, Parameter
cp_6 = ClosestPoint(Point=meshcp_3.Point, Cloud=demesh.Vertices)  # -> ClosestPoint, CPIndex, Distance
duppt_4 = RemoveDuplicatePts(Points=cp_6.ClosestPoint, Tolerance=0.01)

# ---- group: keep smock points on 3d mesh (generally)
meshcp_4 = MeshClosestPoint(Point=pt_9, Mesh=clean_3)  # -> Point, Index, Parameter
meval_3 = MeshEval(Mesh=clean_3, Parameter=meshcp_4.Parameter)  # -> Point, Normal, Colour
cp_7 = ClosestPoint(Point=meval_3.Point, Cloud=demesh.Vertices)  # -> ClosestPoint, CPIndex, Distance
duppt_5 = RemoveDuplicatePts(Points=cp_7.ClosestPoint, Tolerance=0.01)

# ---- group: cull too small smocks
smaller_2 = SmallerThan(FirstNumber=ln, SecondNumber=Slider(2, range=0..10))  # -> SmallerThan, OrEqualTo
dispatch_5 = Dispatch(List=ln, DispatchPattern=smaller_2.SmallerThan)  # -> ListA, ListB

# ---- group: double check correct target pts / 2d mesh vertices
pt_10 = Point(flatten(pt_3))

# ---- group: keep mesh from colliding with itself / mesh vertices
pt_11 = Point(demesh.Vertices)

# ---- group: maintain mesh edges
wbedges = WeaverbirdsMeshEdges(MeshOrPolylines=clean_3)
data = Data(Slider(1, range=0..1))
length_line = LengthLine(Line=wbedges, Strength=data)

# ---- group: inflate mesh
data_2 = Data(Slider(0.0001, range=0..0.0001))
pressure = Pressure(M=clean_3, Strength=data_2)

# ---- group: smocks
crv_24 = Curve(dispatch_5.ListB)

# ---- group: keep smock points on 3d mesh (generally) / smock vertices
pt_12 = Point(duppt_5)

# ---- group: keep smock points on 3d mesh (generally)
data_3 = Data(Slider(5, range=0..10))
onplane = OnPlane(Points=pt_12, Plane=PlaneXY(0, 0, 0), Strength=data_3)

# ----
data_4 = Data(Slider(5, range=0..10))
length_line_2 = LengthLine(Line=crv_24, Length=Slider(0, range=0..100), Strength=data_4)
show = Show(G=clean_3)
show_2 = Show(G=ln)
button_2 = Button()

# ---- group: location of text
pt_13 = Point(Point(575.2189238, -453.1530505, 0))

# ---- group: orient 3d mesh for targeting
area_3 = MeshArea(Mesh=mesh_11)  # -> Area, Centroid
bbox = BoundingBox(Content=mesh_10, Plane=PlaneXY(0, 0, 0))  # -> Box, Box_2
debrep = DeconstructBrep(Brep=bbox.Box)  # -> Faces, Edges, Vertices

# ---- group: orient 3d mesh for targeting / front face
item = ListItem(List=debrep.Faces, Index=number_slider, Wrap=True)
srf = Surface(item)

# ----
srf_2 = Surface(item)

# ---- group: orient 3d mesh for targeting (continued)
area_4 = Area(Geometry=srf)  # -> Area, Centroid
srf_cp = SurfaceClosestPoint(Point=area_4.Centroid, Surface=srf)  # -> Point, UVPoint, Distance
evalsrf = EvaluateSurface(Surface=srf, Point=srf_cp.UVPoint)  # -> Point, Normal, UDirection, VDirection, Frame
pln = Plane(evalsrf.Frame)
orient = Orient(Geometry=mesh_10, Source=pln, Target=area_3.Centroid)  # -> Geometry, Transform

# ---- group: oriented target mesh
mesh_12 = Mesh(orient.Geometry)

# ----
demesh_2 = DeconstructMesh(Mesh=mesh_12)  # -> Vertices, Faces, Colours, Normals

# ---- group: 3d mesh vertices
pt_14 = Point(demesh_2.Vertices)

# ---- group: keep mesh edges on boundary / border discontinutity points
disc_4 = Discontinuity(Curve=ln, Level=1)  # -> flatten(Points), Parameters
crv_cp_2 = CurveClosestPoint(Point=disc_4.Points, Curve=crv_22)  # -> Point, Parameter, Distance
smaller_3 = SmallerThan(FirstNumber=crv_cp_2.Distance, SecondNumber=Slider(0.01, range=0..0.01))  # -> SmallerThan, OrEqualTo
dispatch_6 = Dispatch(List=disc_4.Points, DispatchPattern=smaller_3.SmallerThan)  # -> ListA, ListB
pt_15 = Point(dispatch_6.ListA)
wbnaked_2 = WeaverbirdsNakedBoundary(MeshClosedPolylines=mesh_12)
cp_8 = ClosestPoint(Point=pt_15, Cloud=demesh.Vertices)  # -> ClosestPoint, CPIndex, Distance

# ---- group: keep mesh edges on boundary
data_5 = Data(Slider(5, range=0..10))
oncurve = OnCurve(Points=[cp_8.ClosestPoint, duppt_4], Curve=wbnaked_2, Strength=data_5)

# ---- group: target mesh
mesh_13 = Mesh(mesh_12)
medges = MeshEdges(Mesh=mesh_13)  # -> NakedEdges, InteriorEdges, NonManifoldEdges
swatch = ColourSwatch(SwatchColor=RGB(8, 8, 8))
crv_25 = Curve([medges.NakedEdges, medges.InteriorEdges])

# ---- group: anchor smocks to target mesh vertice / anchor target point to smock 3d
disc_5 = Discontinuity(Curve=crv_17, Level=1)  # -> Points, Parameters
pdecon = Deconstruct(Point=disc_5.Points)  # -> XComponent, YComponent, ZComponent
pt_16 = ConstructPoint(XCoordinate=pdecon.XComponent, YCoordinate=pdecon.YComponent, ZCoordinate=0)
pline = PolyLine(Vertices=pt_16, Closed=True)
area_5 = Area(Geometry=flatten(pline))  # -> Area, Centroid

# ---- group: anchor smocks to target mesh vertice / anchor target point to smock 3d / 2d unsorted smock centroids
pt_17 = Point(simplify(flatten(area_5.Centroid)))

# ---- group: anchor smocks to target mesh vertice / anchor target point to smock 3d (continued)
cp_9 = ClosestPoint(Point=pt_17, Cloud=pt_5)  # -> ClosestPoint, flatten(CPIndex), Distance
item_2 = ListItem(List=pt_14, Index=cp_9.CPIndex, Wrap=True)
pt_18 = Point(item_2)
graft_3 = GraftTree(Tree=pt_18, IncludeEmptyLists=True, IncludeNullItems=True)  # -> simplify(Tree)

# ---- group: anchor smocks to target mesh vertice
data_6 = Data(Slider(5, range=0..10))
anchor = Anchor(Point=duppt_3, Target=graft_3, Strength=data_6)

# ---- group: double check correct target pts / anchor target point to smock 3d
area_6 = Area(Geometry=flatten(pline))  # -> Area, Centroid

# ---- group: double check correct target pts / anchor target point to smock 3d / 2d unsorted smock centroids
pt_19 = Point(simplify(flatten(area_6.Centroid)))

# ---- group: double check correct target pts / anchor target point to smock 3d (continued)
cp_10 = ClosestPoint(Point=pt_19, Cloud=pt_5)  # -> ClosestPoint, flatten(CPIndex), Distance
item_3 = ListItem(List=pt_14, Index=cp_10.CPIndex, Wrap=True)
pt_20 = Point(item_3)

# ---- group: double check correct target pts
graft_4 = GraftTree(Tree=pt_20, IncludeEmptyLists=True, IncludeNullItems=True)  # -> simplify(Tree)
ln_2 = Line(StartPoint=duppt_2, EndPoint=graft_4)
area_7 = Area(Geometry=crv_16)  # -> Area, Centroid
item_4 = ListItem(List=pt_10, Index=cp_10.CPIndex, Wrap=True)
number_slider_2 = Slider(100, range=0..100)
number_slider_3 = Slider(7, range=0..100)
points = PointList(Points=area_7.Centroid, Size=number_slider_3)

# ---- group: double check correct target pts / closed smock centroids
pt_21 = Point(area_7.Centroid)

# ---- group: double check correct target pts / anchor target point to smock 2d
pt_22 = Point(item_4)

# ---- group: double check correct target pts (continued)
points_2 = PointList(Points=pt_22, Size=number_slider_3)

# ---- group: connector lines from flat mesh to 3d mesh
crv_26 = Curve(ln_2)

# ---- group: keep mesh from colliding with itself
wbedges_2 = WeaverbirdsMeshEdges(MeshOrPolylines=clean_3)
len = Length(Curve=wbedges_2)
avr = Average(Input=len)

number_slider_4 = Slider(2, range=0..10)
data_7 = Data(Slider(0.5, range=0..1))

division = Division(A=avr, B=number_slider_4)

sc = SphereCollide(Points=pt_11, Radius=division, Strength=data_7)

# ----
merge = Merge(Data1=length_line, Data2=sc, Data3=onplane, Data4=anchor, Data5=pressure, Data6=oncurve, Data7=length_line_2)
entwine = Entwine(Branch00=merge, Branch01=show, Branch02=show_2, FlattenInputs=True)
solver = Solver(GoalObjects=entwine, Reset=Button(), Threshold=1e-15, Tolerance=0.01, On=Toggle(False))  # -> I, V, O
bang = ExplodeTree(Data=solver.O)  # -> Branch0, Branch1, Branch2, Branch3, Branch4
panel = Panel(solver.I)

# ---- group: smocked mesh
mesh_14 = Mesh(bang.Branch1)
clean_4 = CombineClean(Meshes=mesh_14)
wbedges_3 = WeaverbirdsMeshEdges(MeshOrPolylines=clean_4)
swatch_2 = ColourSwatch(SwatchColor=RGB(66, 66, 66))

# ---- group: smocks
crv_27 = Curve(bang.Branch2)
number_slider_5 = Slider(3, range=0..10)
swatch_3 = ColourSwatch(SwatchColor=RGB(0, 204, 255))

# ----
preview = CustomPreview(Geometry=crv_25, Material=swatch)
preview_2 = CustomPreview(Geometry=wbedges_3, Material=swatch_2)
previewlw = CustomPreviewLineweights(Geometry=crv_27, Shader=swatch_3, Thickness=number_slider_5, Absolute=False)

dam_3 = DataDam(DataA=clean_4, BufferDelay=10000000, BufferMode=0)
wbcatmullclark = WeaverbirdsCatmullClarkSubdivision(MeshCurves=dam_3, Level=1, SmoothNakedEdges=1)

preview_3 = CustomPreview(Geometry=wbcatmullclark, Material=ColourSwatch(SwatchColor=RGBA(156, 156, 156, 92)))

# ---- group: keep track of kangaroo goals
concat = Concatenate(FragmentA="Smock spring tension: ", FragmentB=data_4)
concat_2 = Concatenate(FragmentA="Mesh edge lengths: ", FragmentB=data)
concat_3 = Concatenate(FragmentA="Collision detection: ", FragmentB=data_7)
concat_4 = Concatenate(FragmentA="Smocks anchors:  ", FragmentB=data_6)
concat_5 = Concatenate(FragmentA="P All: ", FragmentB=data_2)
concat_6 = Concatenate(FragmentA="Naked vertices on border: ", FragmentB=data_5)
concat_7 = Concatenate(FragmentA="Iterations: ", FragmentB=solver.I)
concat_8 = Concatenate(FragmentA=concat, FragmentB=concat_2)
concat_9 = Concatenate(FragmentA=concat_8, FragmentB=concat_3)
concat_10 = Concatenate(FragmentA=concat_9, FragmentB=concat_4)
concat_11 = Concatenate(FragmentA=concat_10, FragmentB=concat_5)
concat_12 = Concatenate(FragmentA=concat_11, FragmentB=concat_6)
concat_13 = Concatenate(FragmentA=concat_12, FragmentB=concat_7)
panel_2 = Panel(concat_13)
text = Text(
    Location=pt_13,
    Text=concat_13,
    Size=Slider(19, range=0..100),
    Bold=True,
    HorizontalAlignment=Slider(1, range=0..10),
    VerticalAlignment=Slider(1, range=0..10))
crv_28 = Curve(flatten(text))

# ---- group: kangaroo goal strengths text
crv_29 = Curve(crv_28)

# ----
# bake refined mesh and kangaroo smocking goal strengths
bake = ObjectBake(
    BakeToggle=button_2,
    GeometryObjects=wbcatmullclark,
    Layer="3d sim",
    ObjectName="GH_Obj",
    ObjectColor=RGB(255, 255, 255),
    LayerColor=RGB(255, 255, 255))
bake_2 = ObjectBake(
    BakeToggle=button_2,
    GeometryObjects=crv_27,
    Layer="smocks in sim",
    ObjectName="GH_Obj",
    ObjectColor=RGB(255, 255, 255),
    LayerColor=RGB(255, 255, 255))
bake_3 = ObjectBake(
    BakeToggle=button_2,
    GeometryObjects=crv_28,
    Layer="annotations",
    ObjectName="GH_Obj",
    ObjectColor=RGB(255, 255, 255),
    LayerColor=RGB(255, 255, 255))

# ==== cluster O_GetCompsCluster: Get Used Components: When run, this component will perform two operations. 1 - retreive the plug-in libraries used in the current definition, and write that them to a panel called "PlugIns Used". If the panel does not exist, one will be created. If it does exist, values will be updated. 2 - retrieve all the components being used in the definition, (including thier category and subcategory information if present). It will also give the number of each component/s being used.
# All Components Used: DATE- 2020.12.04 TIME- 14:42h
# Last saved by - annie
# Total Components - 5
# Params:
# ...Primitive:
# ......Boolean - 1
# ...Util:
# ......Button - 1
# ...Input:
# ......Panel - 2
# OTools:
# ...3 | Debugging:
# ......OTools_GetComponents2 - 1
plugins_used = Panel("")
button_to_update = Boolean(ClusterInput()  # Expects Button to Update)
o_getcomps2 = OTools_GetComponents2(x=button_to_update)  # inputs x: Boolean; plug-in component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
